# Dynamo graph Estrapolare Geometria.dyn (Dynamo 2.1.0.7500)

# note: I METODI DI DYNAMO FANNO PENA

categories = Categories("OST_BeamAnalytical")
all_elements_of_category = ElementsOfCategory(Category=categories)
geometry = Element.Geometry(element=all_elements_of_category)
byJoinedCurves = PolyCurve.ByJoinedCurves(curves=geometry)
code_block = CodeBlock(x=byJoinedCurves) { x.EndPoint; x.StartPoint; }
join = List.Join(list0=code_block.out0, list1=code_block.out1)
delete_duplicates = Python(IN[0]=join)
# ---------- delete_duplicates.python (13 lines) ----------
# Load the Python Standard and DesignScript Libraries
import sys
import clr
clr.AddReference('ProtoGeometry')
from Autodesk.DesignScript.Geometry import *

# The inputs to this node will be stored as a list in the IN variables.
input = IN[0]

# Place your code below this line

# Assign your output to the OUT variable.
OUT = set(input);
# ----------------------------------------
dividi_per_telaio = Python(IN[0]=delete_duplicates)
# ---------- dividi_per_telaio.python (28 lines) ----------
# Load the Python Standard and DesignScript Libraries
import sys
import clr
clr.AddReference('ProtoGeometry')
from Autodesk.DesignScript.Geometry import *

# The inputs to this node will be stored as a list in the IN variables.
input = IN[0]

# Place your code below this line
x_coordinates = []
points_by_frame = []

for element in input:
	x_coordinates.append(element.X)

x_coordinates = list(set(x_coordinates))
x_coordinates.sort()

for coordinate in x_coordinates:
	frame_points = []
	for element in input:
		if element.X == coordinate:
			frame_points.append(element)
	points_by_frame.append(frame_points)
			
# Assign your output to the OUT variable.
OUT = points_by_frame;
# ----------------------------------------
firstItem = List.FirstItem(list=dividi_per_telaio)
nodi = Watch(firstItem)
indici = CodeBlock()
# ---------- indici.designscript (6 lines) ----------
[ "span" ,
"storey" ,
"n" ,
"m",
"r",
"sections"];
# ----------------------------------------
coordinates_y = Python(IN[0]=firstItem)
# ---------- coordinates_y.python (18 lines) ----------
# Load the Python Standard and DesignScript Libraries
import sys
import clr
clr.AddReference('ProtoGeometry')
from Autodesk.DesignScript.Geometry import *

# The inputs to this node will be stored as a list in the IN variables.
input = IN[0]

# Place your code below this line
y_coordinates = []

for element in input:
	y_coordinates.append(element.Y)

output = list(set(y_coordinates))
# Assign your output to the OUT variable.
OUT = output;
# ----------------------------------------
sort = List.Sort(list=coordinates_y)
firstItem_2 = List.FirstItem(list=sort)
code_block_2 = CodeBlock { 1; }
getItemAtIndex = List.GetItemAtIndex(list=sort, index=code_block_2)
mm_m = CodeBlock(x=firstItem_2, y=getItemAtIndex) { x - y; }
abs = Math.Abs(number=mm_m)
mm_m_2 = CodeBlock(x=abs) { x/1000; }
campata = Watch(mm_m_2)
categories_2 = Categories("OST_Levels")
all_elements_of_category_2 = ElementsOfCategory(Category=categories_2)
elevations = Python(IN[0]=all_elements_of_category_2)
# ---------- elevations.python (15 lines) ----------
# Load the Python Standard and DesignScript Libraries
import sys
import clr
clr.AddReference('ProtoGeometry')
from Autodesk.DesignScript.Geometry import *

# The inputs to this node will be stored as a list in the IN variables.
input = IN[0]

# Place your code below this line
elevations = []
for element in input:
	elevations.append(round(element.Elevation))
# Assign your output to the OUT variable.
OUT = elevations;
# ----------------------------------------
code_block_3 = CodeBlock { 1; }
getItemAtIndex_2 = List.GetItemAtIndex(list=elevations, index=code_block_3)
mm_m_3 = CodeBlock(x=getItemAtIndex_2) { x/1000; }
# note: INFORMAZIONI ELABORATE
altezza_interpiano = Watch(mm_m_3)
count = List.Count(list=firstItem)
count_2 = List.Count(list=all_elements_of_category_2)
n1 = CodeBlock(x=count_2) { x-1; }  # "-1"
nodi_campate = CodeBlock(y=count, x=n1) { y/x-1; }
round = Math.Round(number=nodi_campate)
numero_di_campate = Watch(round)
numero_di_piani = Watch(n1)
count_3 = List.Count(list=dividi_per_telaio)
numero_di_telai = Watch(count_3)
categories_3 = Categories("OST_StructuralColumns")
all_elements_of_category_3 = ElementsOfCategory(Category=categories_3)
firstItem_3 = List.FirstItem(list=all_elements_of_category_3)
code_block_4 = CodeBlock { "Family"; }
getParameterValueByName = Element.GetParameterValueByName(element=firstItem_3, parameterName=code_block_4)
parameters = Element.Parameters(element=getParameterValueByName)
get_b_and_h = Python(IN[0]=parameters)
# ---------- get_b_and_h.python (15 lines) ----------
# Load the Python Standard and DesignScript Libraries
import sys
import clr
clr.AddReference('ProtoGeometry')
from Autodesk.DesignScript.Geometry import *

# The inputs to this node will be stored as a list in the IN variables.
input = IN[0]

# Place your code below this line
output = []
output.append(input[2])
output.append(input[10])
# Assign your output to the OUT variable.
OUT = output;
# ----------------------------------------
string_from_object = FromObject(obj=get_b_and_h)
code_block_5 = CodeBlock { 0; 4; }
remove = String.Remove(str=string_from_object, startIndex=code_block_5.out0, count=code_block_5.out1)
toNumber = String.ToNumber(str=remove)
mm_m_4 = CodeBlock(x=toNumber) { x/1000; }
categories_4 = Categories("OST_StructuralFraming")
all_elements_of_category_4 = ElementsOfCategory(Category=categories_4)
code_block_6 = CodeBlock { "Family"; }
getParameterValueByName_2 = Element.GetParameterValueByName(element=all_elements_of_category_4, parameterName=code_block_6)
parameters_2 = Element.Parameters(element=getParameterValueByName_2)
get_b_and_h_2 = Python(IN[0]=parameters_2)
# ---------- get_b_and_h_2.python (19 lines) ----------
# Load the Python Standard and DesignScript Libraries
import sys
import clr
clr.AddReference('ProtoGeometry')
from Autodesk.DesignScript.Geometry import *

# The inputs to this node will be stored as a list in the IN variables.
input = IN[0]

# Place your code below this line
sections = []
for element in input:
	section = []
	section.append(element[2])
	section.append(element[11])
	sections.append(section)

# Assign your output to the OUT variable.
OUT = sections;
# ----------------------------------------
code_block_7 = CodeBlock { "Elevation at Top"; }
getParameterValueByName_3 = Element.GetParameterValueByName(element=all_elements_of_category_4, parameterName=code_block_7)
round_2 = Math.Round(number=getParameterValueByName_3)
restOfItems = List.RestOfItems(list=elevations)
create_filter = Python(IN[0]=round_2, IN[1]=restOfItems)
# ---------- create_filter.python (26 lines) ----------
# Load the Python Standard and DesignScript Libraries
import sys
import clr
clr.AddReference('ProtoGeometry')
from Autodesk.DesignScript.Geometry import *

# The inputs to this node will be stored as a list in the IN variables.
beams = IN[0]
elevations = IN[1]

# Place your code below this line
def condition(elevation, beam):
	return elevation == beam
	
number_of_beams = []
for elevation in elevations:
	number_of_beams.append(sum(condition(elevation, beam) for beam in beams))
	
filter = []	
for number in number_of_beams:
	filter.append(True)
	for i in range(1,4):
		filter.append(False)
	
# Assign your output to the OUT variable.
OUT = filter
# ----------------------------------------
filterByBoolMask = List.FilterByBoolMask(list=get_b_and_h_2, mask=create_filter)
string_from_object_2 = FromObject(obj=filterByBoolMask.in)
remove_2 = String.Remove(str=string_from_object_2, startIndex=code_block_5.out0, count=code_block_5.out1)
toNumber_2 = String.ToNumber(str=remove_2)
mm_m_5 = CodeBlock(x=toNumber_2) { x/1000; }
addItemToFront = List.AddItemToFront(item=mm_m_4, list=mm_m_5)
b_e_h_sezioni_0_è_colone = Watch(addItemToFront)
list_join_ma_fatto_bene = Python(IN[0]=campata, IN[1]=altezza_interpiano, IN[2]=numero_di_campate, IN[3]=numero_di_piani, IN[4]=numero_di_telai, IN[5]=b_e_h_sezioni_0_è_colone)
# ---------- list_join_ma_fatto_bene.python (16 lines) ----------
# Load the Python Standard and DesignScript Libraries
import sys
import clr
clr.AddReference('ProtoGeometry')
from Autodesk.DesignScript.Geometry import *

# The inputs to this node will be stored as a list in the IN variables.
input = IN

# Place your code below this line
output = []
for element in input:
	output.append(element)
	
# Assign your output to the OUT variable.
OUT = output
# ----------------------------------------
byKeysValues = DesignScript.Builtin.Dictionary.ByKeysValues(keys=indici, values=list_join_ma_fatto_bene)
dizionario_di_output = Watch(byKeysValues)
byDictionary = JsonData.Elements.JsonObject.ByDictionary(dictionary=dizionario_di_output)
dizionario_di_output_2 = Watch(byDictionary)
file_path = Filename("Output\Telaio.json")
toJsonFile = JsonData.Utilities.Write.ToJsonFile(jsonObjects=dizionario_di_output_2, filepath=file_path)
